# Grasshopper definition DMAS3_FDW.gh (Grasshopper 1.0.7)

# ---- group: Inputs
length = GetInteger(Slider(30, range=10..1000), AtLeast=1, AtMost=1, Maximum=2147483647, Minimum=-2147483648, TreeAccess=False)
hight = GetInteger(Slider(10, range=3..10), AtLeast=1, AtMost=1, Maximum=2147483647, Minimum=-2147483648, TreeAccess=False)
U = GetInteger(Slider(79, range=0..100), AtLeast=1, AtMost=1, Maximum=2147483647, Minimum=-2147483648, TreeAccess=False)
n_points = GetInteger(Slider(7, range=1..100), AtLeast=1, AtMost=1, Maximum=2147483647, Minimum=-2147483648, TreeAccess=False)
V = GetInteger(Slider(4, range=0..100), AtLeast=1, AtMost=1, Maximum=2147483647, Minimum=-2147483648, TreeAccess=False)

# ----
rectangle = Rectangle(Plane=PlaneXY(0, 0, 0), XSize=length, YSize=hight, Radius=0)  # -> Rectangle, Length
area = Area(Geometry=rectangle.Rectangle)  # -> Area, Centroid
orient = Orient(Geometry=rectangle.Rectangle, Source=area.Centroid, Target="0,0,0")  # -> Geometry, Transform
boundary = BoundarySurfaces(Edges=orient.Geometry)
divide = DivideDomain²(Domain=boundary, UCount=U, VCount=V)
subsrf = Isotrim(Surface=boundary, Domain=divide)
area_2 = Area(Geometry=subsrf)  # -> Area, Centroid
pop2d = Populate2D(Region=orient.Geometry, Count=n_points, Seed=1)
graft = GraftTree(Tree=area_2.Centroid, IncludeEmptyLists=True, IncludeNullItems=True)
dist = Distance(PointA=graft, PointB=pop2d)
graph = GraphMapper(dist, x0=0, x1=10, y0=0, y1=10, container_name="Gaussian", factor=1, mean=0.7251615524, sdev=0.1503583789)
ma = MassAddition(Input=graph)  # -> Result, PartialResult
bnd = Bounds(Numbers=flatten(ma.Result))
remap = RemapNumbers(Value=ma.Result, Source=bnd, Target="0 to 90")  # -> flatten(Mapped), Clipped
xz = XZPlane(Origin=Point(0, 0, 0))
rot3d = Rotate3D(Geometry=subsrf, Angle=degrees(remap.Mapped), Center=area_2.Centroid, Axis=xz)  # -> Geometry, Transform
debrep = DeconstructBrep(Brep=rot3d.Geometry)  # -> Faces, Edges, Vertices
pline = PolyLine(Vertices=debrep.Vertices, Closed=True)  # -> flatten(Polyline)
# curves need a property
panel = Panel("90")
gradient = Gradient(
    LowerLimit=0,
    UpperLimit=panel,
    Parameter=remap.Mapped,
    stops=[0: RGB(0, 34, 255), 0.5: RGB(255, 0, 85), 1: RGB(255, 153, 0)])

# ---- group: RH_OUT:Panels
geo = Geometry(rot3d.Geometry)

# ----
c_script = CSharpScript(crv=pline, color=gradient)  # -> out, A; inputs crv: Curve, color: Color
# ---------- c_script: C# ----------
    var c = color.R + "," + color.G + "," + color.B;
    crv.SetUserString("color", c);
    A = crv;
# ---------- end c_script ----------
curve = Curve(flatten(c_script.A))
context_bake = ContextBake(Geometry=geo)
context_bake_2 = ContextBake(Geometry=curve)
preview = CustomPreview(Geometry=curve, Material=gradient)
